# Grasshopper definition Midas_CSV_Visualizer.gh (Grasshopper 1.0.8)

# Load Model Files
panel = Panel("Node.csv")

# ---- group: CSV File Column Index
panel_2 = Panel("0")
panel_3 = Panel("1")
panel_4 = Panel("2")
panel_5 = Panel("3")

# ----
# User Display Options
display_option = ValueList({"Show Element Num": 0, "Show Material Num": 1, "Show Section Num": 2, "Show Section Type": 3, "Show Beam-end-release": 4, "Show Length": 5, "Hide All": 6}, selected="Show Beam-end-release")

directory = FilePath("C:\Users\justi\OneDrive\Desktop\STR_LLM_20250617\CSV_Files\")
panel_6 = Panel(directory)
concatenate = Concatenate(FragmentA=panel_6, FragmentB=panel)
concatenate_2 = Concatenate(FragmentA=panel_6, FragmentB="Element.csv")
concatenate_3 = Concatenate(FragmentA=panel_6, FragmentB="Long_Section.csv")
concatenate_4 = Concatenate(FragmentA=panel_6, FragmentB="Beam_end_release.csv")

# ----
# Import End Release
# CSV File
read_file = ReadFile(File=concatenate_4, PerLineParse=True)

# ----
# Import Node Data CSV File
read_file_2 = ReadFile(File=concatenate, PerLineParse=True)

# ----
# Import Element Data CSV File
read_file_3 = ReadFile(File=concatenate_2, PerLineParse=True)

# ----
# Import Section Data
# CSV File
read_file_4 = ReadFile(File=concatenate_3, PerLineParse=True)

# ----
# Plot Nodes
panel_7 = Panel("1")
split_list = SplitList(List=read_file_2, Index=panel_7)  # -> ListA, ListB
text_split = TextSplit(Text=split_list.ListB, Separators=",")
raw_node_data = Panel(text_split)

list_item = ListItem(List=text_split, Index=panel_2, Wrap=True)
list_item_2 = ListItem(List=text_split, Index=panel_3, Wrap=True)
list_item_3 = ListItem(List=text_split, Index=panel_4, Wrap=True)
list_item_4 = ListItem(List=text_split, Index=panel_5, Wrap=True)

# ----
# Plot
construct_point = ConstructPoint(XCoordinate=list_item_2, YCoordinate=list_item_3, ZCoordinate=list_item_4)

# ----
# Node Index
panel_8 = Panel(list_item)

# ----
# Show
# Element
# Number
# Show
# Material
# Number
# Show
# Section
# Number
# Labels
# Show
# Section
# Type
# Show
# Beam-end-release
panel_9 = Panel("1")
split_list_2 = SplitList(List=read_file, Index=panel_9)  # -> ListA, ListB
split_list_3 = SplitList(List=read_file_4, Index="1")  # -> ListA, ListB
text_split_2 = TextSplit(Text=split_list_2.ListB, Separators=",")
text_split_3 = TextSplit(Text=split_list_2.ListA, Separators=",")
text_split_4 = TextSplit(Text=split_list_3.ListB, Separators=",")
text_split_5 = TextSplit(Text=split_list_3.ListA, Separators=",")
panel_10 = Panel(text_split_3)
panel_11 = Panel(text_split_5)
panel_12 = Panel(text_split_2)
panel_13 = Panel(text_split_4)
list_item_5 = ListItem(List=panel_12, Index="0", Wrap=True)
list_item_6 = ListItem(List=panel_13, Index="0", Wrap=True)
list_item_7 = ListItem(List=panel_13, Index="3", Wrap=True)
flip_matrix = FlipMatrix(Data=list_item_5)
flatten_tree = FlattenTree(Tree=flip_matrix, Path="{0}")
panel_14 = Panel(list_item_6)
panel_15 = Panel(list_item_7)
flatten_tree_2 = FlattenTree(Tree=panel_15, Path="{0}")
flatten_tree_3 = FlattenTree(Tree=panel_14, Path="{0}")
panel_16 = Panel(flatten_tree_2)
panel_17 = Panel(flatten_tree_3)
elem_with_end_release = Panel(flatten_tree)

# ----
# Node 1
# Plot Element
# Plot Elements
# Node 2
# Elements Table
# Data Split by column
panel_18 = Panel("1")
split_list_4 = SplitList(List=read_file_3, Index=panel_18)  # -> ListA, ListB
text_split_6 = TextSplit(Text=split_list_4.ListB, Separators=",")
text_split_7 = TextSplit(Text=split_list_4.ListA, Separators=",")
panel_19 = Panel(text_split_7)
element_data = Panel(text_split_6)
# Importing node data
# into element stream
flip_matrix_2 = FlipMatrix(Data=raw_node_data)
list_item_8 = ListItem(List=element_data, Index="8", Wrap=True)
list_item_9 = ListItem(List=element_data, Index="9", Wrap=True)
list_item_10 = ListItem(List=element_data, Index="0", Wrap=True)
node_data_transpose = Panel(flip_matrix_2)

element_id = Panel(list_item_10)
node_1 = Panel(list_item_8)
node_2 = Panel(list_item_9)

flatten_tree_4 = FlattenTree(Tree=node_2, Path="{0}")
flatten_tree_5 = FlattenTree(Tree=node_1, Path="{0}")
panel_20 = Panel(flatten_tree_5)
panel_21 = Panel(flatten_tree_4)
subtraction = Subtraction(A=panel_20, B="1")
list_item_11 = ListItem(List=node_data_transpose, Index=subtraction, Wrap=True)
subtraction_2 = Subtraction(A=panel_21, B="1")
list_item_12 = ListItem(List=node_data_transpose, Index=subtraction_2, Wrap=True)
panel_22 = Panel(list_item_11)
panel_23 = Panel(list_item_12)
flip_matrix_3 = FlipMatrix(Data=panel_22)
flip_matrix_4 = FlipMatrix(Data=panel_23)
node_1_data = Panel(flip_matrix_3)
node_2_data = Panel(flip_matrix_4)
list_item_13 = ListItem(List=node_1_data, Index="1", Wrap=True)
list_item_14 = ListItem(List=node_1_data, Index="2", Wrap=True)
list_item_15 = ListItem(List=node_1_data, Index="3", Wrap=True)
list_item_16 = ListItem(List=node_2_data, Index="1", Wrap=True)
list_item_17 = ListItem(List=node_2_data, Index="2", Wrap=True)
list_item_18 = ListItem(List=node_2_data, Index="3", Wrap=True)
construct_point_2 = ConstructPoint(XCoordinate=list_item_13, YCoordinate=list_item_14, ZCoordinate=list_item_15)
construct_point_3 = ConstructPoint(XCoordinate=list_item_16, YCoordinate=list_item_17, ZCoordinate=list_item_18)
line = Line(StartPoint=construct_point_2, EndPoint=construct_point_3)

list_item_19 = ListItem(List=element_data, Index="6", Wrap=True)
list_item_20 = ListItem(List=element_data, Index="5", Wrap=True)
panel_24 = Panel(list_item_20)
panel_25 = Panel(list_item_19)
stream_gate = StreamGate(Stream=line, Gate=display_option)  # -> Target0, Target1, Target2, Target3, Target4, Target5, Target6
flatten_tree_6 = FlattenTree(Tree=panel_25, Path="{0}")
flip_matrix_5 = FlipMatrix(Data=element_id)
flatten_tree_7 = FlattenTree(Tree=flip_matrix_5, Path="{0}")
line_dimension = LineDimension(Line=stream_gate.Target2, Text=panel_25, Size="0.09")
line_dimension_2 = LineDimension(Line=stream_gate.Target1, Text=panel_24, Size="0.09")
line_dimension_3 = LineDimension(Line=stream_gate.Target0, Text=element_id, Size="0.09")

panel_26 = Panel(flatten_tree_6)
panel_27 = Panel(flatten_tree_7)
key_value_search = KeyValueSearch(Keys=panel_17, Values=panel_16, Search=panel_26)
panel_28 = Panel(key_value_search)
# Show
# Length (m)
line_dimension_4 = LineDimension(Line=stream_gate.Target5, Text="{0:0.00}", Size="0.08")

ghpython_script = GhPythonScript(elem_index=panel_27, elem_released=elem_with_end_release)  # -> flatten(a); inputs elem_index: list, elem_released: list
# ---------- ghpython_script: Python ----------
a = []

for i in elem_index:
    if i in elem_released:
        a.append("Released")
    else:
        a.append("")
# ---------- end ghpython_script ----------
flip_matrix_6 = FlipMatrix(Data=panel_28)
line_dimension_5 = LineDimension(Line=stream_gate.Target3, Text=flip_matrix_6, Size="0.06")

flip_matrix_7 = FlipMatrix(Data=ghpython_script)

line_dimension_6 = LineDimension(Line=stream_gate.Target4, Text=flip_matrix_7, Size="0.08")
